# Grasshopper definition curveToSound.gh (Grasshopper 1.0.7)

envelope = Curve(<curve referenced from the Rhino model>)
wave = Curve(<curve referenced from the Rhino model>)
expression = Expression(x=Slider(101.06, range=60..170), Expression="2^(x/12)")
square = Curve(<curve referenced from the Rhino model>)
triangle = Curve(<curve referenced from the Rhino model>)
sawtooth = Curve(<curve referenced from the Rhino model>)
sine = Curve(<curve referenced from the Rhino model>)
c_script = CSharpScript(waveForm=wave, envelope=envelope, frequency=expression, amplitude=Slider(0.877, range=0..1), play=Button())  # -> out, A; inputs waveForm: Curve, envelope: Curve, pitch: Curve, frequency: Double, amplitude: Double, play: Boolean
# ---------- c_script: C# usings ----------
using System.IO;
using System.Media;
using System.Text;
using Rhino.Geometry.Intersect;
# ---------- c_script: C# ----------
    // The duration of the sound in seconds
    int duration = 1;

    // Generate the wave
    byte[] wave = GenerateWave(waveForm, envelope, pitch, frequency, amplitude, duration);

    if (play) {
      PlayWave(wave);
    }
# ---------- c_script: C# additional code ----------
  byte[] GenerateWave(Curve waveForm, Curve envelope, Curve pitch, double frequency, double amplitude, int duration) {
    using (MemoryStream memoryStream = new MemoryStream()) {
      using (BinaryWriter writer = new BinaryWriter(memoryStream, Encoding.UTF8)) {
        int sampleRate = 44100;
        short channels = 1;
        short bitsPerSample = 16;
        int sampleCount = sampleRate * duration;
        int samplesPerCycle = (int) (sampleRate / frequency);
        int dataSize = sampleCount * bitsPerSample / 8;
        int fileSize = 44 + dataSize; // Calculate the file size including the header

        // Write header
        writer.Write(Encoding.UTF8.GetBytes("RIFF"));
        writer.Write(fileSize);
        writer.Write(Encoding.UTF8.GetBytes("WAVEfmt "));
        writer.Write(16); // format chunk size
        writer.Write((short) 1); // audio format (1 = PCM)
        writer.Write(channels); // channels
        writer.Write(sampleRate); // sample rate
        writer.Write(sampleRate * bitsPerSample / 8);
        writer.Write((short) (channels * bitsPerSample / 8)); // block align
        writer.Write(bitsPerSample);

        writer.Write(Encoding.UTF8.GetBytes("data"));
        writer.Write(dataSize);

        Point3d oriWav = waveForm.PointAtStart;
        Point3d oriEnv = envelope.PointAtStart;
        // Point3d oriPit = pitch.PointAtStart;

        double amplitudeMax = amplitude * (Math.Pow(2, bitsPerSample - 1) - 1);

        for (int i = 0; i < sampleCount; i++) {

          // get Y of wave graph
          double xWav = oriWav.X + (i % samplesPerCycle) / (double) samplesPerCycle;
          Line lineWav = new Line(new Point3d(xWav, oriWav.Y - 1, 0), new Point3d(xWav, oriWav.Y + 1, 0));
          double valWav = Intersection.CurveLine(waveForm, lineWav, 0.01, 0.01)[0].PointA.Y - oriWav.Y;

          // get Y of envelope
          double xEnv = oriEnv.X + i / (double) sampleCount;
          Line lineEnv = new Line(new Point3d(xEnv, oriEnv.Y, 0), new Point3d(xEnv, oriEnv.Y + 1, 0));
          double valEnv = Intersection.CurveLine(envelope, lineEnv, 0.01, 0.01)[0].PointA.Y - oriEnv.Y;


          short sample = (short) (amplitudeMax * valWav * valEnv);

          writer.Write(sample);
        }

      }

      return memoryStream.ToArray();
    }
  }

  void PlayWave(byte[] wave) {
    using (MemoryStream memoryStream = new MemoryStream(wave)) {
      using (SoundPlayer player = new SoundPlayer(memoryStream)) {
        player.Play();
      }
    }
  }
# ---------- end c_script ----------
